# Grasshopper definition balance-board.gh (Grasshopper 1.0.7)

# Set Drawing Fields.
# Then start drawing 2 curve.
X = Slider(260, range=100..500)
number_slider = Slider(25, range=0..50)
number_slider_2 = Slider(50, range=10..50)
# Draw 2 curves to fit rectangle.
upper_crv = Geometry(<curve referenced from the Rhino model>)
lower_crv = Geometry(<curve referenced from the Rhino model>)
multiplication = Multiplication(A=number_slider_2, B="-1")
rad = Radians(Degrees="180")
rad_2 = Radians(Degrees="120")
rad_3 = Radians(Degrees="120")
pt = ConstructPoint(XCoordinate=0, YCoordinate=0, ZCoordinate=[number_slider, multiplication])
pt_2 = ConstructPoint(XCoordinate=X, YCoordinate=0, ZCoordinate=number_slider)
pt_3 = ConstructPoint(XCoordinate=X, YCoordinate=0, ZCoordinate=multiplication)
xz = XZPlane(Origin=Point(0, 0, 0))
rotate = Rotate(Geometry=[upper_crv, lower_crv], Angle=rad, Plane=PlaneXY(0, 0, 0))  # -> Geometry, Transform
cos = Cosine(Value=rad_3)
sin = Sine(Value=rad_3)
offset = Slider(20, range=0..50)
multiplication_2 = Multiplication(A=X, B=cos)
multiplication_3 = Multiplication(A=X, B=sin)
rec_2pt = Rectangle2Pt(Plane=xz, PointA=Point(0, 0, 0), PointB=pt_2, Radius=0)  # -> Rectangle, Length
rec_2pt_2 = Rectangle2Pt(Plane=xz, PointA=Point(0, 0, 0), PointB=pt_3, Radius=0)  # -> Rectangle, Length
num_x = Number(X)
rad_4 = Radians(Degrees="60")
X_2 = Addition(A=X, B=multiplication_2)
Y = Addition(B=multiplication_3)
cos_2 = Cosine(Value=rad_4)
sin_2 = Sine(Value=rad_4)
division = Division(A=X_2, B="2")
division_2 = Division(A=Y, B="2")
multiplication_4 = Multiplication(A=offset, B=cos_2)
multiplication_5 = Multiplication(A=offset, B=sin_2)
rad_5 = Radians(Degrees="-120")
addition = Addition(A=division, B=multiplication_4)
addition_2 = Addition(A=division_2, B=multiplication_5)
base_pt = ConstructPoint(XCoordinate=X, YCoordinate=0, ZCoordinate=0)
rotated_pt = ConstructPoint(XCoordinate=multiplication_2, YCoordinate=multiplication_3, ZCoordinate=0)
middle_pt = ConstructPoint(XCoordinate=addition, YCoordinate=addition_2, ZCoordinate=0)
rotate_2 = Rotate(Geometry=middle_pt, Angle=rad_2, Plane=PlaneXY(0, 0, 0))  # -> Geometry, Transform
pdecon = Deconstruct(Point=rotate_2.Geometry)  # -> XComponent, YComponent, ZComponent
multiplication_6 = Multiplication(A=pdecon.XComponent, B="-1")
division_3 = Division(A=multiplication_6, B=num_x)
python_scale_objects = GhPythonScript(x=rotate.Geometry, y=division_3)  # -> out, a
# ---------- python_scale_objects: Python ----------
__author__ = "arihirookawa"

import rhinoscriptsyntax as rs


geo = x
origin = (0, 0, 0)

dx = y
scale = (dx, 1, 1)


a = output = rs.ScaleObject(geo, origin, scale, False)
# ---------- end python_scale_objects ----------
rotate_3 = Rotate(Geometry=python_scale_objects.a, Angle=rad_5, Plane=PlaneXY(0, 0, 0))  # -> Geometry, Transform
rad_6 = Radians(Degrees="120")
rad_7 = Radians(Degrees="240")
rad_8 = Radians(Degrees="120")
rad_9 = Radians(Degrees="240")
arc = Arc3Pt(PointA=base_pt, PointB=middle_pt, PointC=rotated_pt)  # -> Arc, Plane, Radius
rotate_4 = Rotate(Geometry=[upper_crv, lower_crv], Angle=rad_6, Plane=PlaneXY(0, 0, 0))  # -> Geometry, Transform
rotate_5 = Rotate(Geometry=[upper_crv, lower_crv], Angle=rad_7, Plane=PlaneXY(0, 0, 0))  # -> Geometry, Transform
rotate_6 = Rotate(Geometry=rotate_3.Geometry, Angle=rad_8, Plane=PlaneXY(0, 0, 0))  # -> Geometry, Transform
rotate_7 = Rotate(Geometry=rotate_3.Geometry, Angle=rad_9, Plane=PlaneXY(0, 0, 0))  # -> Geometry, Transform
crvs = Geometry([upper_crv, lower_crv])
join_1 = JoinCurves(Curves=crvs, Preserve=False)
join_2 = JoinCurves(Curves=rotate_4.Geometry, Preserve=False)
join_3 = JoinCurves(Curves=rotate_5.Geometry, Preserve=False)
join_1_2 = JoinCurves(Curves=rotate_3.Geometry, Preserve=False)

min_z = Number(number_slider_2)
multiplication_7 = Multiplication(A=min_z, B="-2")
max_z = Number(number_slider)
base_plane = PlaneSurface(Plane=PlaneXY(0, 0, 0), XSize="-1000 to 1000", YSize="-1000 to 1000")
division_4 = Division(A=max_z, B="2")
division_5 = Division(A=multiplication_7, B="3")
Z = UnitZ(Factor=division_4)
Z_2 = UnitZ(Factor=division_5)
move = Move(Geometry=base_plane, Motion=Z)  # -> Geometry, Transform
move_2 = Move(Geometry=base_plane, Motion=Z_2)  # -> Geometry, Transform
pcx = CurvePlane(Curve=[join_1, join_1_2, join_2], Plane=move.Geometry, UseTasks=True)  # -> Points, ParamsC, ParamsP
pcx_2 = CurvePlane(Plane=move_2.Geometry)  # -> Points, ParamsC, ParamsP
flatten = FlattenTree(Tree=pcx.Points, Path="{0}")
flatten_2 = FlattenTree(Tree=pcx_2.Points, Path="{0}")
fcircle = CircleFit(Points=flatten_2)  # -> Circle, Radius, Deviation
intcrv = Interpolate(Vertices=flatten, Degree=3, Periodic="False", KnotStyle=1)  # -> Curve, Length, Domain; disabled
intcrv_2 = Interpolate(Vertices=flatten_2, Degree=3, Periodic="True", KnotStyle=1)  # -> Curve, Length, Domain; disabled

join_2_2 = JoinCurves(Curves=rotate_6.Geometry, Preserve=False)
join_3_2 = JoinCurves(Curves=rotate_7.Geometry, Preserve=False)
rad_10 = Radians(Degrees="120")
rad_11 = Radians(Degrees="240")
rotate_8 = Rotate(Geometry=arc.Arc, Angle=rad_10, Plane=PlaneXY(0, 0, 0))  # -> Geometry, Transform
rotate_9 = Rotate(Geometry=arc.Arc, Angle=rad_11, Plane=PlaneXY(0, 0, 0))  # -> Geometry, Transform
arcs = Geometry([arc.Arc, rotate_8.Geometry, rotate_9.Geometry])

loft = Loft(
    Curves=[join_1, join_1_2, join_2],
    Options={Adjust=False, Closed=False, LoftEnds=0, LoftSimp=0, LoftType=0, Rebuild=10, Refit=0.01})
loft_2 = Loft(
    Curves=[join_2, join_2_2, join_3],
    Options={Adjust=False, Closed=False, LoftEnds=0, LoftSimp=0, LoftType=0, Rebuild=10, Refit=0.01})
loft_3 = Loft(
    Curves=[join_3, join_3_2, join_1],
    Options={Adjust=False, Closed=False, LoftEnds=0, LoftSimp=0, LoftType=0, Rebuild=10, Refit=0.01})
join = BrepJoin(Breps=[loft, loft_2, loft_3])  # -> Breps, Closed
num_x_2 = Number(X)
multiplication_8 = Multiplication(A=num_x_2, B="2")
X_3 = UnitX(Factor=multiplication_8)
move_3 = Move(Geometry=join.Breps, Motion=X_3)  # -> Geometry, Transform
output = Geometry(move_3.Geometry)
